# Grasshopper definition rnd_node.gh (Grasshopper 1.0.7)

# ----
# Domain Start
start = Slider(24.341, range=0..100)
negative = Negative(Value=start)

# ----
# Domain End
end = Slider(10.294, range=0..100)

# ----
# Count
count = Slider(11.2, range=0..100)

start_2 = GetNumber(negative, AtLeast=1, AtMost=1, Maximum=1.797693135e+308, Minimum=-1.797693135e+308)
count_2 = GetNumber(count, AtLeast=1, AtMost=1, Maximum=1.797693135e+308, Minimum=-1.797693135e+308)
end_2 = GetNumber(end, AtLeast=1, AtMost=1, Maximum=1.797693135e+308, Minimum=-1.797693135e+308)
construct_domain = ConstructDomain(DomainStart=start_2, DomainEnd=end_2)
steps = Slider(90, range=0..100)
range = Range(Domain=construct_domain, Steps=steps)
construct_point = ConstructPoint(XCoordinate=0, YCoordinate=0, ZCoordinate=range)
random = Random(Range=Slider(37.452, range=0..100), Number=count_2, Seed=Slider(22, range=0..100))
random_2 = Random(Range=Slider(17.188, range=0..100), Number=count_2, Seed=Slider(11, range=0..100))
random_3 = Random(Range=Slider(11.306, range=0..100), Number=count_2, Seed=Slider(15, range=0..100))
treshold = Slider(0.155, range=0..1)
construct_point_2 = ConstructPoint(XCoordinate=random, YCoordinate=random_2, ZCoordinate=random_3)
xy_plane = XYPlane(Origin=construct_point)
metaball_t = MetaBallT(Points=construct_point_2, Plane=xy_plane, Threshold=treshold)  # -> flatten(Isocurve)
pt = ConstructPoint(XCoordinate=0, YCoordinate=0, ZCoordinate=0)
rebuild_curve = RebuildCurve(Curve=metaball_t, Degree="3", Count="50", Tangents=False)
curvepoint = PointOnCurve(rebuild_curve, parameter=0.5)
pull = PullPoint(Point=curvepoint, Geometry=pt, ClosestOnly=True)  # -> ClosestPoint, Distance
bnd = Bounds(Numbers=pull.Distance)
remap = RemapNumbers(Value=pull.Distance, Source=bnd, Target=Domain(0, 1))  # -> Mapped, Clipped
gradient = Gradient(
    LowerLimit=0,
    UpperLimit=1,
    Parameter=remap.Mapped,
    stops=[0: RGB(137, 121, 151), 0: RGB(255, 255, 255), 0: RGB(83, 124, 45), 0: RGB(32, 10, 46), 0: RGB(15, 10, 203), 0: RGB(149, 104, 61), 0: RGB(137, 50, 171), 0: RGB(3, 71, 36), 0: RGB(64, 244, 33), 0.472: RGB(104, 210, 205), 1: RGB(0, 0, 0)])
c_script = CSharpScript(crv=rebuild_curve, color=gradient)  # -> out, A; inputs crv: Curve, color: Color
# ---------- c_script: C# ----------
    var c = color.R + "," + color.G + "," + color.B;
    crv.SetUserString("color", c);
    A = crv;
# ---------- end c_script ----------

# ---- group: RH_OUT:edges
curve = Curve(flatten(c_script.A))
