# Grasshopper definition rnd_node.gh (Grasshopper 1.0.7)
# plug-ins: Weaverbird, Kangaroo Components

count = Slider(500, range=0..1000)
radius = Slider(18, range=0..100)
radius_2 = GetNumber(radius, AtLeast=1, AtMost=1, Maximum=1.797693135e+308, Minimum=-1.797693135e+308)
count_2 = GetNumber(count, AtLeast=1, AtMost=1, Maximum=1.797693135e+308, Minimum=-1.797693135e+308)
sph = Sphere(Base=PlaneXY(0, 0, 0), Radius=radius_2)
popgeo = PopulateGeometry(Geometry=sph, Count=count_2, Seed=1)
facet = FacetDome(Points=popgeo)  # -> Pattern, Dome
area = Area(Geometry=facet.Pattern)  # -> Area, Centroid
num = Number(radius_2)
sub_division_level = Slider(3, range=0..10)
crv_cp = CurveClosestPoint(Point=area.Centroid, Curve=facet.Pattern)  # -> Point, Parameter, Distance
multiplication = Multiplication(A=num, B=Slider(1.34, range=0..1.5))
sub_division_level_2 = Slider(3, range=0..3)
pt = Point(crv_cp.Point)
num_2 = Number(count_2)
wbicosahedron = WeaverbirdsMeshMeshIcosahedron(Plane=PlaneXY(0, 0, 0), Radius=multiplication)
wbcatmullclark = WeaverbirdsCatmullClarkSubdivision(MeshCurves=wbicosahedron, Level=sub_division_level, SmoothNakedEdges=1)
popgeo_2 = PopulateGeometry(Geometry=sph, Count=num_2, Seed=1, Points=pt)
wbcatmullclark_2 = WeaverbirdsCatmullClarkSubdivision(MeshCurves=wbcatmullclark, Level=sub_division_level_2, SmoothNakedEdges=1)
demesh = DeconstructMesh(Mesh=wbcatmullclark_2)  # -> Vertices, Faces, Colours, Normals
pull = PullPoint(Point=demesh.Vertices, Geometry=pt, ClosestOnly=True)  # -> ClosestPoint, Distance
pull_2 = PullPoint(Point=demesh.Vertices, Geometry=popgeo_2, ClosestOnly=True)  # -> ClosestPoint, Distance
smaller = SmallerThan(FirstNumber=pull.Distance, SecondNumber=pull_2.Distance)  # -> SmallerThan, OrEqualTo
frgb = ColourRGBF(Alpha=1, Red=smaller.SmallerThan, Green=smaller.SmallerThan, Blue=smaller.SmallerThan)
mcol = MeshColours(Mesh=wbcatmullclark_2, Colours=frgb)
mblur = BlurMesh(Mesh=mcol, Iterations=Slider(7, range=0..10))
demesh_2 = DeconstructMesh(Mesh=mblur)  # -> Vertices, Faces, Colours, Normals

# ----
# Extruding point via bump map
number_slider = Slider(10, range=0..100)
argb = SplitARGB(Colour=demesh_2.Colours)  # -> Alpha, Red, Green, Blue
remap = RemapNumbers(Value=argb.Red, Source=Domain(0, 1), Target=number_slider)  # -> Mapped, Clipped
amp = Amplitude(Vector=demesh_2.Normals, Amplitude=remap.Mapped)
move = Move(Geometry=demesh_2.Vertices, Motion=amp)  # -> Geometry, Transform

conmesh = ConstructMesh(Vertices=move.Geometry, Faces=demesh_2.Faces, Colours=demesh_2.Colours)
clean = CombineClean(Meshes=conmesh)
medges = MeshEdges(Mesh=clean)  # -> NakedEdges, InteriorEdges, NonManifoldEdges
preview = CustomPreview(Geometry=conmesh, Material=ColourSwatch(SwatchColor=RGB(255, 255, 255)))

# ---- group: RH_OUT:edges
crv = Curve(medges.InteriorEdges)

# ---- group: RH_OUT:mesh
mesh = Mesh(clean)
