# Grasshopper definition color_test.gh (Grasshopper 1.0.7)

series = Series(Start="1", Step=1, Count="3")
dom = ConstructDomain(DomainStart=series, DomainEnd=expr("-x", series))
rectangle = Rectangle(Plane=PlaneXY(0, 0, 0), XSize=dom, YSize=dom, Radius=0)  # -> Rectangle, Length
item = ListItem(List=rectangle.Rectangle, Index=0, Wrap=True)  # -> Item, Item1, Item2

# ---- group: RH_OUT:red
rh_out_rectangles = Curve(item.Item)

# ---- group: RH_OUT:rect / RH_OUT:blue
rh_out_rectangles_2 = Curve(item.Item2)

# ---- group: RH_OUT:rect / RH_OUT:green
rh_out_rectangles_3 = Curve(item.Item1)
